# Grasshopper definition 01_SaddleNet.ghx (Grasshopper 1.0.8)
# plug-ins: Arachne

demo = DemoSaddleNet(Divisions=4, Span=10, Rise=2)  # -> Lines, Supports, Faces
cable = Cable(Line=demo.Lines, Target=1, Kind=0, Project=False, TargetWeight=0, Direction=-1, Chord=0, Area=0, Density=0)
node = NodeConditions(Point=demo.Supports, FixX=True, FixY=True, FixZ=True, Force=Vector(0, 0, 0), PositionWeight=Vector(0, 0, 0))
model = Model(Cables=cable, Conditions=node, Faces=demo.Faces, Tolerance=1e-06)  # -> Model, Nodes, Cables
settings = SolverSettings(
    Solver=0,
    MaxIterations=100,
    Tolerance=0.0001,
    Gravity=0,
    Pressure=0,
    CreateMesh=True,
    Plane=PlaneXY(0, 0, 0),
    AlgebraicIterations=0,
    AlgebraicToleranceA=0,
    AlgebraicToleranceB=0)
ff = FormFind(Model=model.Model, Settings=settings, Run=Toggle(False))  # -> Nodes, Cables, Mesh, AxialForces, ForceDensities, PressureForces, Status, Log, OuterIterations
panel = Panel(ff.Status)
panel_2 = Panel(ff.Log)
